# Grasshopper definition getunitymesh.gh (Grasshopper 1.0.7)

md_slider = MDSlider(
    SliderMode=0,
    slider_value=Point(0.6762196611, 0.676219475, 0.5),
    x_domain=Domain(0, 10),
    y_domain=Domain(0, 10),
    z_domain=Domain(0, 1))
receivemesh = CSharpScript()  # -> A
# ---------- receivemesh: C# ----------
    Register(Component);

    A = mesh;
# ---------- receivemesh: C# additional code ----------
  Mesh mesh = null;
  bool registered = false;
  IGH_Component comp = null;

  void Register(IGH_Component component)
  {
    if(!registered)
    {
      Rhino.Runtime.HostUtils.RegisterNamedCallback("SendObject", ToGrasshopper);

      comp = component;

      registered = true;
    }
  }

  void ToGrasshopper(object sender, Rhino.Runtime.NamedParametersEventArgs args)
  {
    Rhino.Geometry.GeometryBase[] values;
    if (args.TryGetGeometry("mesh", out values))
      mesh = values[0] as Rhino.Geometry.Mesh;

    comp.ExpireSolution(true);
  }
# ---------- end receivemesh ----------
move = Move(Geometry=receivemesh, Motion=md_slider)  # -> Geometry, Transform
